# Grasshopper definition rdf_input_example.gh (Grasshopper 1.0.7)
# plug-ins: BH.UI.Grasshopper, TTLadapter

material = Material(Name="S235", Density=nan, Component="{ .Material")
boxprofile = BoxProfile(Height="0.096", Width="0.100", Thickness="0.008", OuterRadius=0, InnerRadius=0, Component="{ .BoxProfile")
constantframingproperty = ConstantFramingProperty(Profile=boxprofile, Material=material, OrientationAngle=0, Name="Hea100", Component="{ .ConstantFramingProperty")
columns_yard = Point([Point(41.23751446, 21.20152552, 0), Point(54.50277559, 14.38383497, 0), Point(47.87014503, 14.38383497, 0), Point(41.23751446, 14.38383497, 0)])
columns_main_building = Point([Point(67.76803672, 30.38460176, 0), Point(61.13540616, 30.38460176, 0), Point(54.50277559, 30.38460176, 0), Point(47.87014503, 30.38460176, 0), Point(67.76803672, 21.20152552, 0), Point(61.13540616, 21.20152552, 0), Point(54.50277559, 21.20152552, 0), Point(47.87014503, 21.20152552, 0)])
column = Column(BasePoint=columns_yard, Height="0.48", Property=constantframingproperty, Name="yard columns", Component="{ .Column")
column_2 = Column(
    BasePoint=columns_main_building,
    Height="3.75",
    Property=constantframingproperty,
    Name="house columns",
    Component="{ .Column")

basicgraphsettings = BasicGraphSettings(
    OntologyTitle="house modernist architecture",
    OntologyDescription="house modernist architecture",
    TBoxURI="https://schema.org",
    ABoxURI="https://individuals.org/",
    SerializeGeoToBase64=Toggle(True),
    Component="{ .BasicGraphSettings")
# Log-in GraphDB
# AnkitaSaha
# igah4Eewai
# https://kg.informatik.uni-stuttgart.de/repositories/DigitalTwinsLab2023
# http://localhost:7200/
graphdbadapter = GraphDBAdapter(
    RepositoryName="BHoMGraphDBRepo",
    ServerAddress="http://localhost:7200/",
    GraphName="defaultGraph",
    ClearGraph=False,
    PushTimeoutMillisec=10000,
    GraphSettings=basicgraphsettings,
    Activate=Toggle(True),
    Component="{ ..ctor")

construction = Construction(Component="{ .Construction")
floor_main_building = Curve(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)
floor_yard = Curve(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)
floor = Floor(Construction=construction, Edges=floor_main_building, Component="{ .Floor")
floor_2 = Floor(Construction=construction, Edges=floor_yard, Component="{ .Floor")

room = Curve(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)
area = Area(Geometry=room)  # -> Area, Centroid
room_2 = Room(Perimeter=room, Location=area.Centroid, Name="Main Room", Component="BH.oM.Architecture.Elements.Room")

ceiling = Curve(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)
construction_2 = Construction(Component="BH.oM.Physical.Constructions.Construction")
srf = Surface(ceiling)
ceiling_2 = Ceiling(Surface=srf, Construction=construction_2, Name="Main Room Ceiling", Component="BH.oM.Architecture.Elements.Ceiling")

architect = CreateCustom(
    Type="Architect",
    Name="Ludwig Mies van der Rohe",
    DateOfBirth="27. March 1886",
    Component="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")
building = CreateCustom(
    Type="Building",
    Name="Farnsworth house",
    YearOfConstruction="1951",
    Site_Location="14520 River Rd, Plano, IL 60545, US",
    Architect=architect,
    Rooms=room_2,
    Floors=[floor, floor_2],
    Ceilings=ceiling_2,
    Columns=[column, column_2],
    Component="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")
push = Push(
    Adapter=graphdbadapter,
    Objects=flatten(building),
    PushType="{ \"_t\" : \"System.Enum\", \"TypeName\" : { \"_t\" : \"System.Type\", \"Name\" : \"BH.oM.Adapter.PushType\", \"_bhomVersion\" : \"7.0\" }, \"Value\" : \"AdapterDefault\", \"_bhomVersion\" : \"7.0\" }",
    Active=Toggle(True),
    Component="{ .Push")  # -> Objects, Success
panel = Panel(push.Success)
data = Data(push.Objects)
panel_2 = Panel(data)
ttladapter = TTLadapter(RunTTLAdapter=Toggle(False), RDF=data)
