# Grasshopper definition test.gh (Grasshopper 1.0.7)
# plug-ins: GraphWebsite

boolean_toggle = BooleanToggle(False)
graphwebsite = GraphWebsite(
    GraphDBURL="http://kg:7200/repositories/rdf4jtest",
    Account="user1",
    Password="user1",
    Open=boolean_toggle,
    RunServer=boolean_toggle)
panel = Panel(graphwebsite)
